% Requirement links of HilTest.m (R2026b)

% line 17 verifies requirements.slreqx#8
% line 17 verifies requirements.slreqx#9
% line 17 verifies requirements.slreqx#14
        function normalOperation(tc)

% line 28 verifies requirements.slreqx#8
        function periodUnderCpuLoad(tc)

% line 39 verifies requirements.slreqx#11
        function processingRate(tc)

% line 50 verifies requirements.slreqx#14
% line 50 verifies requirements.slreqx#15
        function stallStopsSending(tc)

% line 67 verifies requirements.slreqx#17
        function bootStatus(tc)

% line 78 verifies requirements.slreqx#17
        function noModelStopsAfterBootTimeout(tc)

% line 88 verifies requirements.slreqx#16
% line 88 verifies requirements.slreqx#14
        function canFailureKeepsRunning(tc)